# Grasshopper definition m-06.gh (Grasshopper 0.9.76)
# plug-ins: Python Interpreter, HDTReference

file_path = FilePath("C:\Users\danil\Documents\GitHub\gda\dummy data\d-11 Team assignment data.pkl")
file_path_2 = FilePath("C:\Users\danil\Documents\GitHub\gda\dummy data\d-10 graph data.pkl")
file_path_3 = FilePath("C:\Users\danil\Documents\GitHub\gda\data\-team_data.json")
file_path_4 = FilePath("C:\Users\danil\Documents\GitHub\gda\dummy data\d-09 graph assignment data.pkl")
python = PythonScript(x=file_path)  # -> a
# ---------- python: Python ----------
import pickle

data = pickle.load( open(x, 'rb') )

print data

a = pickle.dumps(data)
# ---------- end python ----------
python_2 = PythonScript(x=file_path_2)  # -> a
# ---------- python_2: Python ----------
import pickle

data = pickle.load( open(x, 'rb') )

a = pickle.dumps(data)
# ---------- end python_2 ----------
python_3 = PythonScript(x=file_path_4)  # -> a
# ---------- python_3: Python ----------
import pickle

data = pickle.load( open(x, 'rb') )

a = pickle.dumps(data["amenities"])
# ---------- end python_3 ----------
python_4 = PythonScript()  # -> path
# ---------- python_4: Python ----------
import pickle

path = ghenv.LocalScope.ghdoc.Path
path = path.split("\\")
path = "\\".join(path[:-3]) + "\\python resources"
# ---------- end python_4 ----------
view_inputs = PythonScript(resource_path=python_4, a_data=python_3, g=python_2, t=python, t_pref=file_path_3)
# ---------- view_inputs: Python ----------
from __future__ import generators
import pickle
import json
import rhinoscriptsyntax as rs

import sys
sys.path.append(resource_path)
from dijkstra import Dijkstra

graph = pickle.loads(g)
am_data = pickle.loads(a_data)
team_data = pickle.loads(t)

with open(t_pref, 'r') as f:
    team_pref = json.load(f)

print graph["nodes"][123]

print team_data
# ---------- end view_inputs ----------
adjacency = PythonScript(resource_path=python_4, a_data=python_3, g=python_2, t=python, t_pref=file_path_3, makeData=Toggle(True))  # -> out, pts, vals, lines, lines_val, d13, d14, cost_total
# ---------- adjacency: Python ----------
from __future__ import generators
import pickle
import json
import rhinoscriptsyntax as rs

import sys
sys.path.append(resource_path)
from dijkstra import Dijkstra

graph = pickle.loads(g)
am_data = pickle.loads(a_data)
team_data = pickle.loads(t)

with open(t_pref, 'r') as f:
    team_pref = json.load(f)

edge_traversal = {}

def mutateGraph(P, start, end):
    # calculate path
    Path = []
    while True:
        Path.append(end)
        if end == start: break
        end = P[end]
    Path.reverse()
    
    # add node traversal
    for node in Path[1:-1]:
        if "traversal" not in graph["nodes"][node].keys():
            graph["nodes"][node]["traversal"] = 0
        graph["nodes"][node]["traversal"] += 1
    
    # add edge traversal
    for j, node2 in enumerate(Path[1:]):
        node1 = Path[j]
        if node1 not in edge_traversal.keys():
            edge_traversal[node1] = {}
        if node2 not in edge_traversal[node1].keys():
            edge_traversal[node1][node2] = 0
        edge_traversal[node1][node2] += 1
    return Path

cost_total = 0.0

# iterate through all teams
for m, manager1 in enumerate(team_pref.keys()):
    
    print "team:", manager1
    
    # get all desks for team
    desks1 = team_data[manager1]
    
    # initialize costs
    cost_withinTeam = 0.0
    cost_outsideTeam = 0.0
    cost_amenity = 0.0
    
    # iterate over each desk
    for d1 in desks1:
        
        # compute minimum paths from desk to each node in graph
        D, P = Dijkstra(graph["edges"], d1)
        
        # add to internal team cost
        cost_withinTeam += (sum([D[x] for x in desks1])/len(desks1))
        
        for pref in [0, 1, 2]:
            
            # calculate team to team preference
            for n, manager2 in enumerate(team_pref[manager1]['adjacency-teams'][pref]):
#                print m, manager1, '-->', n, manager2
                
                # get all desks in other team
                try:
                    desks2 = team_data[manager2]
                except KeyError as e:
                    print "manager not found:", e
                    continue
                
                # add traversal info to graph
                for d2 in desks2:
                    mutateGraph(P, d1, d2)
                
                # add to total cost
                cost_outsideTeam += (sum([D[x] for x in desks2])/len(desks2))
                
#                break
            
            # calculate team to amenity preference
            for n, amenity in enumerate(team_pref[manager1]['adjacency-amenity'][pref]):
#                print m, manager1, '-->', n, amenity
                
                # get all locations for amenity
                try:
                    amenity_loc = am_data[amenity]
                except KeyError as e:
                    print "amenity not found:", e
                    continue
                
                # add traversal info to graph
                for d2 in amenity_loc:
                    mutateGraph(P, d1, d2)
                
                # add to total cost
                cost_amenity += (sum([D[x] for x in amenity_loc])/len(amenity_loc))
                
#                break
            
#            break
    
    
#    print "total cost within team:", cost_withinTeam
#    print "total cost to outside teams:", cost_outsideTeam
#    print "total cost to amenities:", cost_amenity
    
    cost_total += (cost_withinTeam + cost_outsideTeam + cost_amenity)

print cost_total


if makeData:
    # make d-13
    
    node_traversal = {}
    
    pts = []
    vals = []
    
    for i, node in enumerate(graph["nodes"]):
        if "traversal" in node.keys():
            node_traversal[i] = node["traversal"]
            pts.append(rs.AddPoint(node["coords"]))
            vals.append(node["traversal"])
    
    # make d-14
    
    lines_dict = {}
    
    for node1 in edge_traversal.keys():
        for node2 in edge_traversal[node1].keys():
            traversal = edge_traversal[node1][node2]
            if (node2, node1) in lines_dict.keys():
                lines_dict[(node2, node1)] += traversal
            else:
                if (node1, node2) not in lines_dict.keys():
                    lines_dict[(node1, node2)] = 0
                lines_dict[(node1, node2)] += traversal
    
    lines = []
    lines_val = []
    
    edge_traversal = []
    
    for key in lines_dict.keys():
        
        edge_traversal.append({"start point": graph["nodes"][key[0]]["coords"], "end point": graph["nodes"][key[1]]["coords"], "traversal": lines_dict[key]})
        
        lines.append(rs.AddLine(graph["nodes"][key[0]]["coords"], graph["nodes"][key[1]]["coords"]))
        lines_val.append(lines_dict[key])
    
    # output data sets
    
    print node_traversal
    d13 = pickle.dumps(node_traversal)
    
    print edge_traversal
    d14 = pickle.dumps(edge_traversal)
# ---------- end adjacency ----------
division = Division(A=adjacency.vals, B=Slider(295.5, range=0..1000))
cluster = Cluster(num=adjacency.vals)  # -> C, R
circle = CircleCNR(Center=adjacency.pts, Normal=Vector(0, 0, 1), Radius=division)
cluster_2 = Cluster(num=adjacency.lines_val)  # -> C, R
boundary = BoundarySurfaces(Edges=graft(circle))
write_data = PythonScript(path="C:\Users\danil\Documents\GitHub\gda\dummy data\", d13=adjacency.d13, d14=adjacency.d14)  # -> out
# ---------- write_data: Python ----------
import pickle

n_data = pickle.loads(d13)
e_data = pickle.loads(d14)

#print n_data

with open(path+"d-13 node traversal data.pkl", 'wb') as f:  
    pickle.dump(n_data, f, pickle.HIGHEST_PROTOCOL)

with open(path+"d-14 edge traversal data.pkl", 'wb') as f:  
    pickle.dump(e_data, f, pickle.HIGHEST_PROTOCOL)
# ---------- end write_data ----------
preview = CustomPreview(Geometry=boundary, Shader=graft(cluster.C))
multiplication = Multiplication(A=cluster_2.R, B=Slider(10, range=0..10))
addition = Addition(A=multiplication, B=Slider(1, range=0..1))
previewlw = CustomPreviewLineweights(Geometry=adjacency.lines, Shader=cluster_2.C, Thickness=addition)

# ==== cluster Cluster
num = ClusterInput()
num_2 = Number(num)
bnd = Bounds(Numbers=num_2)
dedomain = DeconstructDomain(Domain=bnd)  # -> Start, End
remap = RemapNumbers(Value=num_2, Source=bnd, Target=Domain(0, 1))  # -> Mapped, Clipped
gradient = Gradient(
    LowerLimit=dedomain.Start,
    UpperLimit=dedomain.End,
    Parameter=num_2,
    stops=[0: RGB(0, 128, 0), 0.5: RGB(255, 255, 0), 1: RGB(255, 0, 0)])
C = ClusterOutput(gradient)
R = ClusterOutput(remap.Mapped)
